# Grasshopper definition CP.gh (Grasshopper 1.0.7)
# plug-ins: Volvox, NGon

# ----
# PRE-ALIGNMENT
reference_mesh = Mesh([<mesh referenced from the Rhino model> x6])
xz = XZPlane(Origin=Point(0, 0, 0))
xy = XYPlane(Origin=Point(0, 0, 0))
crv = Curve(<curve referenced from the Rhino model>)
crv_2 = Curve(<curve referenced from the Rhino model>)
meshboolean = MeshBoolean(Mesh=reference_mesh, Type="1", LC=True)
angle = Angle(VectorA=crv, VectorB=crv_2, Plane=xz)  # -> Angle, Reflex
angle_2 = Angle(VectorA=crv, VectorB=crv_2, Plane=xy)  # -> Angle, Reflex
end = EndPoints(Curve=crv)  # -> Start, End
end_2 = EndPoints(Curve=crv_2)  # -> Start, End
Z = UnitZ(Factor=1)
vec2pt = Vector2Pt(PointA=end.Start, PointB=end_2.Start, Unitize=False)  # -> Vector, Length
move = Move(Geometry=end_2.Start, Motion=Z)  # -> Geometry, Transform
move_2 = Move(Geometry=meshboolean, Motion=vec2pt.Vector)  # -> Geometry, Transform
pi = Pi(Factor=0.5)
ln = Line(StartPoint=end_2.Start, EndPoint=move.Geometry)
rotax = RotateAxis(Geometry=move_2.Geometry, Angle=angle_2.Angle, Axis=ln)  # -> Geometry, Transform
rad = Radians(Degrees=Slider(1.525, range=0..10))
rotax_2 = RotateAxis(Geometry=crv_2, Angle=pi, Axis=ln)  # -> Geometry, Transform
rotax_3 = RotateAxis(Geometry=rotax.Geometry, Angle=rad, Axis=rotax_2.Geometry)  # -> Geometry, Transform

# ----
# Instructions
# 1. Set the path to the E57 file to compare
# 
# 2. Reference the reference mesh to compare with
path_of_file_to_compare = FilePath("D:\OneDrive - Universidade do Minho\SIFA - Ficheiros de Bruno Acácio Ferreira Figueiredo\00_TRABALHO\5_Modelo Cortiça\Fotogrametria\DC_High_Original_crop.e57")
run = BooleanToggle(True)
abort = Button()
loade57 = LoadE57(FilePath=path_of_file_to_compare, Index=-1, Percent=Slider(100, range=0..100), Run=run, Abort=abort, Check=False)  # -> Cloud, Pose

# ---- group: ALIGNED BOUNDING BOX
# OBJECT ALIGNED BOUNDING BOX
end_3 = EndPoints(Curve=crv_2)  # -> Start, End
line = LineSDL(Start=end_3.Start, Direction=Vector(0, 0, 1), Length=1)
pi_2 = Pi(Factor=".5")
vrot = Rotate(Vector=crv_2, Axis=line, Angle=pi_2)
pl = ConstructPlane(Origin=end_3.Start, XAxis=crv_2, YAxis=vrot)
bbox = BoundingBox(Content=rotax_3.Geometry, Plane=pl)  # -> Box, Box_2

# ---- group: Filtrar uma parte especifica da nuvem de pontos
mesh = Mesh(bbox.Box)
mcloud = MergeClouds(Cloud=loade57.Cloud)
minclude = MeshInclude(Cloud=mcloud, Mesh=mesh, Leave=Toggle(False))

# ---- group: Distância à mesh
# COLOR BY DISTANCE
mesh_para_comparar = Mesh(rotax_3.Geometry)
mcompare = MeshCompare(Cloud=minclude, Mesh=mesh_para_comparar, Key="CP")
bounds = Bounds(Cloud=mcompare, Key="CP")
dominio_de_distâncias = Panel(bounds)
genes = GenePool(Decimals=2, Maximum=18, Minimum=-26, Value=[-16.08, -10.89, -3.02, 3.06, 10.05, 16.12])
merge = Merge(
    Data1=ColourSwatch(SwatchColor=RGB(3, 32, 255)),
    Data2=ColourSwatch(SwatchColor=RGB(112, 3, 255)),
    Data3=ColourSwatch(SwatchColor=RGB(179, 3, 255)),
    Data4=ColourSwatch(SwatchColor=RGB(255, 158, 3)),
    Data5=ColourSwatch(SwatchColor=RGB(255, 87, 3)),
    Data6=ColourSwatch(SwatchColor=RGB(255, 3, 3)))
prevdata = PreviewData(Cloud=mcompare, Key="CP", Values=genes, Colors=merge)
