# Grasshopper definition Finishing.gh (Grasshopper 1.0.8)
# Copyright: ©2021 Filipe Brandão
# plug-ins: Pufferfish, KUKA|prc - parametric robot control

resolution = Slider(10, range=1..12)
mesh = Mesh(<mesh referenced from the Rhino model>)

# ---- group: Resample Mesh
bbox = BoundingBox(Content=mesh, Plane=PlaneXY(0, 0, 0))  # -> Box, Box_2
brec = BoundingRectangle(Geometry=mesh, Plane=PlaneXY(0, 0, 0), Axis=0, Slide=0, Union=True)  # -> Bounding, DimensionX, DimensionY
subtraction = Subtraction(A=brec.DimensionY, B="1")
subtraction_2 = Subtraction(A=brec.DimensionX, B="1")
integer_division = IntegerDivision(A=brec.DimensionX, B=resolution)
dom = ConstructDomain(DomainStart="1", DomainEnd=subtraction_2)
dom_2 = ConstructDomain(DomainStart="1", DomainEnd=subtraction)
integer_division_2 = IntegerDivision(A=brec.DimensionY, B=resolution)
box = EvaluateBox(Box=bbox.Box, UParameter="0", VParameter="0", WParameter="-10")  # -> Plane, Point, Include
range = Range(Domain=dom_2, Steps=integer_division_2)
range_2 = Range(Domain=dom, Steps=integer_division)
pt = PointOriented(BasePlane=box.Plane, UComponent=graft(range_2), VComponent=range, WComponent=0)  # -> flatten(Point)
Z = UnitZ(Factor=1)
project = ProjectPoint(Point=pt, Direction=Z, Geometry=mesh)  # -> Point, Index
patch = Patch(Points=project.Point, Spans=Slider(50, range=0..100), Flexibility=Slider(7, range=0..10), Trim=True)  # disabled
srfgrid = SurfaceFromPoints(Points=project.Point, UCount="101", Interpolate=False)

# ----
stepover_mm = Slider(6, range=0..20)
spindle_w_bit = Geometry([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])
sunion = SolidUnion(Breps=spindle_w_bit)
number_slider = Slider(-10, range=-180..181)  # disabled
rad = Radians(Degrees=number_slider)  # disabled
panel = Panel("""32
56-58
68
89-90""")
panel_2 = Panel("0.041")  # disabled
rad_2 = Radians(Degrees=Slider(-30, range=-180..181))
pt_2 = Point(<point referenced from the Rhino model>)
mr = MesaRobotKR1202700()
preview = CustomPreview(Geometry=mr, Material=ColourSwatch(SwatchColor=RGB(0, 0, 0)))
number_slider_2 = Slider(0, range=0..180)  # disabled
number_slider_3 = Slider(0, range=0..180)  # disabled
number_slider_4 = Slider(0, range=-180..181)  # disabled
number_slider_5 = Slider(0, range=0..180)  # disabled
number_slider_6 = Slider(0, range=0..180)  # disabled
number_slider_7 = Slider(0, range=-180..181)  # disabled
rotação_de_planos = RotaçãoDePlanos(plane=Point(0, 0, 0), X_2=number_slider_3, Y_2=number_slider_2, Z_2=number_slider_4)  # -> flatten(plane_2); disabled
rotação_de_planos_2 = RotaçãoDePlanos(plane=Point(0, 0, 0), X_2=number_slider_6, Y_2=number_slider_5, Z_2=number_slider_7)  # -> flatten(plane_2); disabled

srf = Surface(srfgrid)
path_sampling_mm = Slider(10, range=0..20)
workpiece_clearence_mm = Slider(30, range=0..40)
brec_2 = BoundingRectangle(Geometry=srf, Plane=PlaneXY(0, 0, 0), Axis=0, Slide=0, Union=True)  # -> Bounding, DimensionX, DimensionY
division = Division(A=brec_2.DimensionY, B=path_sampling_mm)
division_2 = Division(A=brec_2.DimensionX, B=path_sampling_mm)
round = Round(Number=division)  # -> Nearest, Floor, Ceiling
drec = DeconstuctRectangle(Rectangle=brec_2.Bounding)  # -> BasePlane, XInterval, YInterval
round_2 = Round(Number=division_2)  # -> Nearest, Floor, Ceiling
deplane = DeconstructPlane(Plane=drec.BasePlane)  # -> Origin, XAxis, YAxis, ZAxis
amp = Amplitude(Vector=deplane.YAxis, Amplitude=workpiece_clearence_mm)
amp_2 = Amplitude(Vector=deplane.XAxis, Amplitude=workpiece_clearence_mm)

division_3 = Division(A=brec_2.DimensionX, B=stepover_mm)
division_4 = Division(A=brec_2.DimensionY, B=stepover_mm)
round_3 = Round(Number=division_4)  # -> Nearest, Floor, Ceiling
round_4 = Round(Number=division_3)  # -> Nearest, Floor, Ceiling
sframes = SurfaceFrames(Surface=srf, UCount=round_2.Ceiling, VCount=round_3.Ceiling)  # -> simplify(Frames), Parameters

sframes_2 = SurfaceFrames(Surface=srf, UCount=round_4.Ceiling, VCount=round.Ceiling)  # -> simplify(Frames), Parameters
flip = FlipMatrix(Data=sframes.Frames)
move_first_last = MoveFirstLast(obj=flip, vec=amp_2)
move_first_last_2 = MoveFirstLast(obj=sframes_2.Frames, vec=amp)
split = SplitTree(Data=move_first_last_2, Masks=flatten("{(0,2,...)}"))  # -> Positive, reverse(Negative)
split_2 = SplitTree(Data=move_first_last, Masks=flatten("{(0,2,...)}"))  # -> Positive, reverse(Negative)

# ---- group: Largura
merge = Merge(Data1=split_2.Positive, Data2=split_2.Negative)  # -> flatten(Result)

# ---- group: Comprimento
merge_2 = Merge(Data1=split.Positive, Data2=split.Negative)  # -> flatten(Result)

# ----
direcao_b = Plane(merge)
direcao_a = Plane(merge_2)

orient = Orient(Geometry=sunion, Source=PlaneXY(0, 0, 0), Target=direcao_a)  # -> Geometry, Transform
colom = CollisionOneMany(Collider=orient.Geometry, Obstacles=srf)  # -> Collision, Index
mindex = MemberIndex(Set=colom.Collision, Member=Toggle(True))  # -> Index, Count

orient_2 = Orient(Geometry=sunion, Source=PlaneXY(0, 0, 0), Target=direcao_b)  # -> Geometry, Transform
colom_2 = CollisionOneMany(Collider=orient_2.Geometry, Obstacles=srf)  # -> Collision, Index
mindex_2 = MemberIndex(Set=colom_2.Collision, Member=Toggle(True))  # -> Index, Count

# ---- group: Direcao A / Rotate Plane to avoid Collisions
rotateframes = CSharpScript(S=srf, G=sunion, F=direcao_a, index=mindex.Index)  # -> out, Crvs, Pts, P; inputs S: Surface, G: Brep, F: list of Plane, index: list of Int32
# ---------- rotateframes: C# ----------
// Author:
//       Filipe J.S. Brandão
//
// Copyright (c) 2023 ©2023 Filipe Brandao
//
// Permission is hereby granted, free of charge, to any person obtaining a copy
// of this software and associated documentation files (the "Software"), to deal
// in the Software without restriction, including without limitation the rights
// to use, copy, modify, merge, publish, distribute, sublicense, and/or sell
// copies of the Software, and to permit persons to whom the Software is
// furnished to do so, subject to the following conditions:
//
// The above copyright notice and this permission notice shall be included in
// all copies or substantial portions of the Software.
//
// THE SOFTWARE IS PROVIDED "AS IS", WITHOUT WARRANTY OF ANY KIND, EXPRESS OR
// IMPLIED, INCLUDING BUT NOT LIMITED TO THE WARRANTIES OF MERCHANTABILITY,
// FITNESS FOR A PARTICULAR PURPOSE AND NONINFRINGEMENT. IN NO EVENT SHALL THE
// AUTHORS OR COPYRIGHT HOLDERS BE LIABLE FOR ANY CLAIM, DAMAGES OR OTHER
// LIABILITY, WHETHER IN AN ACTION OF CONTRACT, TORT OR OTHERWISE, ARISING FROM,
// OUT OF OR IN CONNECTION WITH THE SOFTWARE OR THE USE OR OTHER DEALINGS IN
// THE SOFTWARE.

// A brute force clash avoidance algorithm
    
    List<Curve> int_curves = new List<Curve>();
    List<Point3d> int_points = new List<Point3d>();

    for(int j = 0; j < index.Count; j++){
      if(j == 100) break;
      int i = index[j];
      Transform trans = Transform.Identity;
      trans = Transform.PlaneToPlane(Plane.WorldXY, F[i]);
      Brep B = (Brep) G.Duplicate();
      B.Transform(trans);

      const double tol = 0.001;
      Curve[] curves;
      Point3d[] points;
      Rhino.Geometry.Intersect.Intersection.BrepSurface(B, S, tol, out curves, out points);
      if(curves.Length > 0 || points.Length > 0){
        if(curves.Length > 0){
          Print("intersection curves found at {0}", i);
          // There might be more than one curve, so we join them.
          Curve[] Loops = Curve.JoinCurves(curves);
          Vector3d crossP = Vector3d.Zero;
          Double angle = 0.0;
          foreach(Curve l in Loops){
            // The curves might not be planar so we need to find the best fit plane and project the curve
            List<Point3d> crvPts = new List<Point3d>();
            crvPts.Add(l.PointAtStart);
            crvPts.Add(l.PointAtNormalizedLength(0.25));
            crvPts.Add(l.PointAtNormalizedLength(0.5));
            crvPts.Add(l.PointAtNormalizedLength(0.75));
            crvPts.Add(l.PointAtEnd);
            Plane fitPlane = Plane.Unset;
            Plane.FitPlaneToPoints(crvPts, out fitPlane);
            // Now we project the curve to the plane
            Curve planarLoop = Curve.ProjectToPlane(l, fitPlane);
            // And find the midpoint
            AreaMassProperties amp = AreaMassProperties.Compute(planarLoop);
            // Now we compute the vector to the midpoint
            Vector3d vector = new Vector3d(amp.Centroid - F[i].Origin);
            // Determine the rotation axis and angle between the plane z.axis and the vector
            Vector3d thisCrossP = Vector3d.CrossProduct(F[i].Normal, vector);
            if(thisCrossP.Length > crossP.Length){
              crossP = thisCrossP;
              angle = Math.Asin(crossP.Length / (F[i].Normal.Length * vector.Length));
            }
          }
          Plane pl = F[i];
          pl.Rotate(-angle, crossP);
          F[i] = pl;

        }else{
          Print("intersection points found at {0}", i);
        }
        int_curves.AddRange(curves);
        int_points.AddRange(points);
      }

    }

    Crvs = int_curves;
    Pts = int_points;
    P = F;
# ---------- end rotateframes ----------
orient_3 = Orient(Geometry=sunion, Source=PlaneXY(0, 0, 0), Target=rotateframes.P)  # -> Geometry, Transform
colom_3 = CollisionOneMany(Collider=orient_3.Geometry, Obstacles=srf)  # -> Collision, Index

# ---- group: Direcao A
ma = MassAddition(Input=colom_3.Collision)  # -> Result, PartialResults
mindex_3 = MemberIndex(Set=colom_3.Collision, Member=Toggle(True))  # -> Index, Count
tem_que_ser_0 = Panel(ma.Result)
rotateframes_2 = CSharpScript(S=srf, G=sunion, F=rotateframes.P, index=mindex_3.Index)  # -> out, Crvs, Pts, P; inputs S: Surface, G: Brep, F: list of Plane, index: list of Int32
# ---------- rotateframes_2: C# ----------
    // Author:
//       Filipe J.S. Brandão
//
// Copyright (c) 2023 ©2023 Filipe Brandao
//
// Permission is hereby granted, free of charge, to any person obtaining a copy
// of this software and associated documentation files (the "Software"), to deal
// in the Software without restriction, including without limitation the rights
// to use, copy, modify, merge, publish, distribute, sublicense, and/or sell
// copies of the Software, and to permit persons to whom the Software is
// furnished to do so, subject to the following conditions:
//
// The above copyright notice and this permission notice shall be included in
// all copies or substantial portions of the Software.
//
// THE SOFTWARE IS PROVIDED "AS IS", WITHOUT WARRANTY OF ANY KIND, EXPRESS OR
// IMPLIED, INCLUDING BUT NOT LIMITED TO THE WARRANTIES OF MERCHANTABILITY,
// FITNESS FOR A PARTICULAR PURPOSE AND NONINFRINGEMENT. IN NO EVENT SHALL THE
// AUTHORS OR COPYRIGHT HOLDERS BE LIABLE FOR ANY CLAIM, DAMAGES OR OTHER
// LIABILITY, WHETHER IN AN ACTION OF CONTRACT, TORT OR OTHERWISE, ARISING FROM,
// OUT OF OR IN CONNECTION WITH THE SOFTWARE OR THE USE OR OTHER DEALINGS IN
// THE SOFTWARE.

// A brute force clash avoidance algorithm

    List<Curve> int_curves = new List<Curve>();
    List<Point3d> int_points = new List<Point3d>();

    for(int j = 0; j < index.Count; j++){
      if(j == 100) break;
      int i = index[j];
      Transform trans = Transform.Identity;
      trans = Transform.PlaneToPlane(Plane.WorldXY, F[i]);
      Brep B = (Brep) G.Duplicate();
      B.Transform(trans);

      const double tol = 0.001;
      Curve[] curves;
      Point3d[] points;
      Rhino.Geometry.Intersect.Intersection.BrepSurface(B, S, tol, out curves, out points);
      if(curves.Length > 0 || points.Length > 0){
        if(curves.Length > 0){
          Print("intersection curves found at {0}", i);
          // There might be more than one curve, so we join them.
          Curve[] Loops = Curve.JoinCurves(curves);
          Vector3d crossP = Vector3d.Zero;
          Double angle = 0.0;
          foreach(Curve l in Loops){
            // The curves might not be planar so we need to find the best fit plane and project the curve
            List<Point3d> crvPts = new List<Point3d>();
            crvPts.Add(l.PointAtStart);
            crvPts.Add(l.PointAtNormalizedLength(0.25));
            crvPts.Add(l.PointAtNormalizedLength(0.5));
            crvPts.Add(l.PointAtNormalizedLength(0.75));
            crvPts.Add(l.PointAtEnd);
            Plane fitPlane = Plane.Unset;
            Plane.FitPlaneToPoints(crvPts, out fitPlane);
            // Now we project the curve to the plane
            Curve planarLoop = Curve.ProjectToPlane(l, fitPlane);
            // And find the midpoint
            AreaMassProperties amp = AreaMassProperties.Compute(planarLoop);
            // Now we compute the vector to the midpoint
            Vector3d vector = new Vector3d(amp.Centroid - F[i].Origin);
            // Determine the rotation axis and angle between the plane z.axis and the vector
            Vector3d thisCrossP = Vector3d.CrossProduct(F[i].Normal, vector);
            if(thisCrossP.Length > crossP.Length){
              crossP = thisCrossP;
              angle = Math.Asin(crossP.Length / (F[i].Normal.Length * vector.Length));
            }
          }
          Plane pl = F[i];
          pl.Rotate(-angle, crossP);
          F[i] = pl;

        }else{
          Print("intersection points found at {0}", i);
        }
        int_curves.AddRange(curves);
        int_points.AddRange(points);
      }

    }

    Crvs = int_curves;
    Pts = int_points;
    P = F;
# ---------- end rotateframes_2 ----------
orient_4 = Orient(Geometry=sunion, Source=PlaneXY(0, 0, 0), Target=rotateframes_2.P)  # -> Geometry, Transform; disabled
colom_4 = CollisionOneMany(Collider=orient_4.Geometry, Obstacles=srf)  # -> Collision, Index; disabled
spindle_w_bit_2 = Geometry([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, Point(35, -22.5, 14), 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])
panel_3 = Panel("0.041")
ma_2 = MassAddition(Input=colom_4.Collision)  # -> Result, PartialResults
tem_que_ser_0_2 = Panel(ma_2.Result)
quantec_2_kr120_kr210_r2700_robot = Quantec2KR120KR210R2700Robot(infiniterot=True)
custom_tool_kuka_prc = CustomToolKUKAPrc(
    CustomToolGeometry=spindle_w_bit_2,
    isExternal=False,
    toolid=3,
    toolvala=0,
    toolvalb=-30,
    toolvalc=0,
    toolvalx=150.23,
    toolvaly=2.26,
    toolvalz=283.36,
    valuesset=True)
number_slider_8 = Slider(0, range=0..1)
spl_move = SPLineMovementKUKAPrc(Speed=panel_3, extaxenabled=False, interpolation="C_ORI")  # -> flatten(KUKAPrcCommand); disabled

# ---- group: Direcao A / Rotate Plane to avoid Collisions (continued)
item = ListItem(List=orient_3.Geometry, Index=mindex_3.Index, Wrap=True)

# ----
rotate = Rotate(Geometry=rotateframes_2.P, Angle=rad_2, Plane=rotateframes_2.P)  # -> Geometry, Transform
orient_pln = OrientPlaneKUKAPrc(Plane=rotate.Geometry, OrientPoint=pt_2)
lin_move = LINearMovementKUKAPrc(TargetAsPlane=orient_pln, Speed=panel_3, extaxenabled=False, interpolation="C_DIS")
kuka_prc = KUKAPrcCORE(
    SimulationSlider=number_slider_8,
    KUKAPrcCommands=lin_move,
    Tool=custom_tool_kuka_prc,
    Robot=quantec_2_kr120_kr210_r2700_robot,
    PRC_BaseExpose=False,
    PRC_SaveNameExpose=False,
    PRCsettings="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")  # -> RobotGeometry, AnalysisOutput

# ---- group: Direção B
rotateframes_3 = CSharpScript(S=srf, G=sunion, F=direcao_b, index=mindex_2.Index)  # -> out, Crvs, Pts, P; inputs S: Surface, G: Brep, F: list of Plane, index: list of Int32; disabled
# ---------- rotateframes_3: C# ----------
    List<Curve> int_curves = new List<Curve>();
    List<Point3d> int_points = new List<Point3d>();

    for(int j = 0; j < index.Count; j++){
      if(j == 100) break;
      int i = index[j];
      Transform trans = Transform.Identity;
      trans = Transform.PlaneToPlane(Plane.WorldXY, F[i]);
      Brep B = (Brep) G.Duplicate();
      B.Transform(trans);

      const double tol = 0.001;
      Curve[] curves;
      Point3d[] points;
      Rhino.Geometry.Intersect.Intersection.BrepSurface(B, S, tol, out curves, out points);
      if(curves.Length > 0 || points.Length > 0){
        if(curves.Length > 0){
          Print("intersection curves found at {0}", i);
          // There might be more than one curve, so we join them.
          Curve[] Loops = Curve.JoinCurves(curves);
          Vector3d crossP = Vector3d.Zero;
          Double angle = 0.0;
          foreach(Curve l in Loops){
            // The curves might not be planar so we need to find the best fit plane and project the curve
            List<Point3d> crvPts = new List<Point3d>();
            crvPts.Add(l.PointAtStart);
            crvPts.Add(l.PointAtNormalizedLength(0.25));
            crvPts.Add(l.PointAtNormalizedLength(0.5));
            crvPts.Add(l.PointAtNormalizedLength(0.75));
            crvPts.Add(l.PointAtEnd);
            Plane fitPlane = Plane.Unset;
            Plane.FitPlaneToPoints(crvPts, out fitPlane);
            // Now we project the curve to the plane
            Curve planarLoop = Curve.ProjectToPlane(l, fitPlane);
            // And find the midpoint
            AreaMassProperties amp = AreaMassProperties.Compute(planarLoop);
            // Now we compute the vector to the midpoint
            Vector3d vector = new Vector3d(amp.Centroid - F[i].Origin);
            // Determine the rotation axis and angle between the plane z.axis and the vector
            Vector3d thisCrossP = Vector3d.CrossProduct(F[i].Normal, vector);
            if(thisCrossP.Length > crossP.Length){
              crossP = thisCrossP;
              angle = Math.Asin(crossP.Length / (F[i].Normal.Length * vector.Length));
            }
          }
          Plane pl = F[i];
          pl.Rotate(-angle, crossP);
          F[i] = pl;

        }else{
          Print("intersection points found at {0}", i);
        }
        int_curves.AddRange(curves);
        int_points.AddRange(points);
      }

    }

    Crvs = int_curves;
    Pts = int_points;
    P = F;
# ---------- end rotateframes_3 ----------
orient_5 = Orient(Geometry=sunion, Source=PlaneXY(0, 0, 0), Target=rotateframes_3.P)  # -> Geometry, Transform; disabled
toggle = BooleanToggle(True)  # disabled
colom_5 = CollisionOneMany(Collider=orient_5.Geometry, Obstacles=srf)  # -> Collision, Index; disabled
ma_3 = MassAddition(Input=colom_5.Collision)  # -> Result, PartialResults; disabled
mindex_4 = MemberIndex(Set=colom_5.Collision, Member=toggle)  # -> Index, Count; disabled
tem_que_ser_0_3 = Panel(ma_3.Result)  # disabled
item_2 = ListItem(List=orient_5.Geometry, Index=mindex_4.Index, Wrap=True)  # disabled
rotateframes_4 = CSharpScript(S=srf, G=sunion, F=rotateframes_3.P, index=mindex_4.Index)  # -> out, Crvs, Pts, P; inputs S: Surface, G: Brep, F: list of Plane, index: list of Int32; disabled; same code as rotateframes_3
number_slider_9 = Slider(0, range=0..180)  # disabled
number_slider_10 = Slider(0, range=0..180)  # disabled
number_slider_11 = Slider(0, range=-180..181)  # disabled
orient_6 = Orient(Geometry=sunion, Source=PlaneXY(0, 0, 0), Target=rotateframes_4.P)  # -> Geometry, Transform; disabled
colom_6 = CollisionOneMany(Collider=orient_6.Geometry, Obstacles=srf)  # -> Collision, Index; disabled
spindle_w_bit_3 = Geometry([<curve referenced from the Rhino model> x2, <brep referenced from the Rhino model> x13, <curve referenced from the Rhino model> x3, <brep referenced from the Rhino model>, <curve referenced from the Rhino model> x2, <point referenced from the Rhino model>, <brep referenced from the Rhino model> x45])  # disabled
number_slider_12 = Slider(0.004, range=0..1)  # disabled
ma_4 = MassAddition(Input=colom_6.Collision)  # -> Result, PartialResults; disabled
quantec_2_kr120_kr210_r2700_robot_2 = Quantec2KR120KR210R2700Robot(infiniterot=True)  # disabled
custom_tool_kuka_prc_2 = CustomToolKUKAPrc(
    CustomToolGeometry=spindle_w_bit_3,
    isExternal=False,
    toolid=2,
    toolvala=0,
    toolvalb=-30,
    toolvalc=0,
    toolvalx=152.25,
    toolvaly=2.9,
    toolvalz=284.59,
    valuesset=True)  # disabled

# ----
rotate_2 = Rotate(Geometry=rotateframes_4.P, Angle=rad, Plane=rotateframes_4.P)  # -> Geometry, Transform; disabled
lin_move_2 = LINearMovementKUKAPrc(TargetAsPlane=rotate_2.Geometry, Speed=panel_2, extaxenabled=False, interpolation="C_DIS")  # disabled

# ---- group: Direção B (continued)
kuka_prc_2 = KUKAPrcCORE(
    SimulationSlider=number_slider_12,
    KUKAPrcCommands=lin_move_2,
    Tool=custom_tool_kuka_prc_2,
    Robot=quantec_2_kr120_kr210_r2700_robot_2,
    PRC_BaseExpose=False,
    PRC_SaveNameExpose=False,
    PRCsettings="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")  # -> RobotGeometry, AnalysisOutput; disabled

# ==== cluster MoveFirstLast
obj = ClusterInput()  # Object in a list to move
vec = ClusterInput()
vec_2 = Vector(vec)

# ---- group: First
item = ListItem(List=obj, Index=0, Wrap=True)

# ---- group: Last
item_2 = ListItem(List=obj, Index=-1, Wrap=True)

# ----
rev = Reverse(Vector=vec_2)
move = Move(Geometry=item_2, Motion=vec_2)  # -> simplify(Geometry), Transform
move_2 = Move(Geometry=item, Motion=rev)  # -> simplify(Geometry), Transform
merge = Merge(Data1=move_2.Geometry, Data2=obj, Data3=move.Geometry)

R = ClusterOutput(merge)

# ==== cluster RotaçãoDePlanos: Rotação de planos em xyz
plane = ClusterInput()  # Plane to be rotated
X = UnitX(Factor=1)
xy = XYPlane(Origin=plane)
xy_2 = XYPlane(Origin=plane)
xy_3 = XYPlane(Origin=plane)
Y = UnitY(Factor=1)
Z = UnitZ(Factor=1)
line = LineSDL(Start=xy, Direction=X, Length=1)
X_2 = ClusterInput()
line_2 = LineSDL(Start=xy_2, Direction=Y, Length=1)
line_3 = LineSDL(Start=xy_3, Direction=Z, Length=1)
Y_2 = ClusterInput()  # Y
Z_2 = ClusterInput()  # Z
rot3d = Rotate3D(Geometry=xy, Angle=degrees(X_2), Center=xy, Axis=line)  # -> Geometry, Transform
rot3d_2 = Rotate3D(Geometry=rot3d.Geometry, Angle=degrees(Y_2), Center=xy_2, Axis=line_2)  # -> Geometry, Transform
rot3d_3 = Rotate3D(Geometry=rot3d_2.Geometry, Angle=degrees(Z_2), Center=xy_3, Axis=line_3)  # -> Geometry, Transform
plane_2 = ClusterOutput(rot3d_3.Geometry)

# ==== cluster MesaRobotKR1202700

# ---- group: Mesa do robot
mesa_do_robot = Brep(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)

xy = XYPlane(Origin=Point(0, 0, 0))
area = Area(Geometry=mesa_do_robot)  # -> Area, Centroid
project = Project(Geometry=area.Centroid, Plane=xy)  # -> Geometry, Transform
pt = ConstructPoint(XCoordinate=0, YCoordinate=0, ZCoordinate="-750")
orient = Orient(Geometry=mesa_do_robot, Source=project.Geometry, Target=pt)  # -> Geometry, Transform

# ----
G = ClusterOutput(orient.Geometry)
