# Grasshopper definition Fusion360Import_KukaPRC.gh (Grasshopper 1.0.7)
# plug-ins: KUKA|prc - parametric robot control, Pufferfish

velocidade_de_avanço = Slider(0.2, range=0..0.2)

# ---- group: CantoDirFundo
# Posicionamento manual do código
# gerado no Fusion com base em pontos
# medidos com o robot.
panel = Panel("2389.78")
pt = ConstructPoint(XCoordinate=panel, YCoordinate="-972.86", ZCoordinate="-275.65")

# ---- group: CantoEsqFundo
pt_2 = ConstructPoint(XCoordinate="2390.32", YCoordinate="836.81", ZCoordinate="-276.01")

# ---- group: CantoEsq
pt_3 = ConstructPoint(XCoordinate="1396.74", YCoordinate="838.39", ZCoordinate="-274.76")

# ---- group: CantoDir
pt_4 = ConstructPoint(XCoordinate="1396.28", YCoordinate="-968.54", ZCoordinate="-274.11")

# ----
# INPUTS
spindle_w_bit = Geometry([<brep referenced from the Rhino model> x17])
custom_tool_kuka_prc = CustomToolKUKAPrc(
    CustomToolGeometry=spindle_w_bit,
    toolid=2,
    toolvala=0,
    toolvalb=-30,
    toolvalc=0,
    toolvalx=152.25,
    toolvaly=2.9,
    toolvalz=284.59,
    valuesset=True)
quantec_2_kr120_kr210_r2700_robot = Quantec2KR120KR210R2700Robot(infiniterot=False)
simular_posição = Slider(0, range=0..1)

# ----
# Ponto auxiliar para orientar os planos da ferramenta.
point = Point(<point referenced from the Rhino model>)

# ----
# Caminho para o ficheiro com o codigo exportado do Fusion360
file_path = FilePath("C:\Users\Utilizador\Desktop\DesbasteCortiça\Desbaste_KRL\Desbaste_Final.xml")

vec2pt = Vector2Pt(PointA=pt_4, PointB=pt_3, Unitize=False)  # -> Vector, Length
vec2pt_2 = Vector2Pt(PointA=pt_4, PointB=pt, Unitize=False)  # -> Vector, Length

# ----
# Geração dos comandos de movimento
# do robot a partir dos caminhos gerados
# no Fusion 360
fusion_360_nc_import_kuka_prc = Fusion360NCImportKUKAPrc(
    Path=file_path,
    OverrideFeedRate=-1,
    TolerancePointsInCartesianSpace=0,
    ToleranceAngleValues=0,
    RapidSpeed=velocidade_de_avanço,
    OrientationPoint=point,
    ExternalAxis=0)

pl = ConstructPlane(Origin=pt_4, XAxis=vec2pt.Vector, YAxis=vec2pt_2.Vector)
brec = BoundingRectangle(Geometry=[pt, pt_2, pt_3, pt_4], Plane=pl, Axis=0, Slide=0, Union=True)  # -> Bounding, DimensionX, DimensionY
area = Area(Geometry=brec.Bounding)  # -> Area, Centroid

# ----
# Geração do código para fabricação
# Simulação dos movimentos do robot
# Simulação de colisões
kuka_prc_core = KUKAPrcCORE(
    SimulationSlider=simular_posição,
    KUKAPrcCommands=fusion_360_nc_import_kuka_prc,
    Tool=custom_tool_kuka_prc,
    Robot=quantec_2_kr120_kr210_r2700_robot,
    PRC_BaseExpose=False,
    PRC_SaveNameExpose=False,
    PRCsettings="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")  # -> RobotGeometry, AnalysisOutput

panel_2 = Panel(fusion_360_nc_import_kuka_prc)
panel_3 = Panel(area.Centroid)
panel_4 = Panel(kuka_prc_core.RobotGeometry)

# ----
# Análise da simulação da execução
# do código (tempos, colisões, etc..)
analysis_kuka_prc = AnalysisKUKAPrc(KUKAPrcAnalysisData=kuka_prc_core.AnalysisOutput)  # -> RobotAxisValues, RobotCollisionCheck, RobotReachabilityCheck, CommandID, TimeValue, Planes, CommandTags, IOState, Index, KRL; disabled

list_item = ListItem(List=flatten(analysis_kuka_prc.TimeValue), Index="-1", Wrap=True)
